# Grasshopper definition 3.gh (Grasshopper 1.0.7)

number_slider = Slider(-150, range=-200..0)

# ----
# Link Interior
brep = Brep([<brep referenced from the Rhino model> x64])

number_slider_2 = Slider(1000, range=0..1000)  # disabled
# CAMERA
number_slider_3 = Slider(272, range=-1000..1000)  # disabled
number_slider_4 = Slider(-1124, range=-1200..-255)  # disabled
number_slider_5 = Slider(12, range=0..100)  # disabled
# CAMERA
number_slider_6 = Slider(223, range=0..1000)
# SECTION PERSPECTIVE
# ELEVATION ROTATION
geometry = Geometry([<brep referenced from the Rhino model> x1576])
number_slider_7 = Slider(15, range=0..20)
bounding_box = BoundingBox(Content=geometry, Plane=PlaneXY(0, 0, 0), UnionBox=True)  # -> Box, Box_2
construct_point = ConstructPoint(XCoordinate=number_slider, YCoordinate=number_slider, ZCoordinate=0)
domain_box = DomainBox(Base=PlaneXY(0, 0, 0), X=Slider(500, range=0..1000), Y=Slider(500, range=0..1000), Z=Slider(200, range=0..1000))
brep_wireframe = BrepWireframe(Brep=brep, Density=-1)
construct_point_2 = ConstructPoint(XCoordinate=number_slider_6, YCoordinate=Slider(-809, range=-1000..500), ZCoordinate=Slider(65, range=0..100))
volume = Volume(Geometry=bounding_box.Box)  # -> Volume, Centroid
construct_point_3 = ConstructPoint(XCoordinate=number_slider_3, YCoordinate=number_slider_4, ZCoordinate=number_slider_5)  # disabled
number_slider_8 = Slider(0, range=0..10)
division = Division(A=Slider(800, range=0..1000), B=number_slider_7)
square = Square(Plane=construct_point, Size=number_slider_7, ExtentX=division, ExtentY=division)  # -> Cells, Points
construct_domain = ConstructDomain(DomainStart=Slider(64, range=0..100), DomainEnd=Slider(209, range=0..300))
populate_3d = Populate3D(Region=domain_box, Count=Slider(14, range=0..30), Seed=1)
number_slider_9 = Slider(63, range=0..360)
extend_curve = ExtendCurve(Curve=brep_wireframe, Type=0, Start=number_slider_8, End=number_slider_8)
area = Area(Geometry=square.Cells)  # -> Area, flatten(Centroid)
addition = Addition(A=number_slider_4, B=number_slider_2)  # disabled
xy_plane = XYPlane(Origin=volume.Centroid)
list_length = ListLength(List=populate_3d)
# TARGET
construct_point_4 = ConstructPoint(XCoordinate=number_slider_3, YCoordinate=addition, ZCoordinate=number_slider_5)  # disabled
rotate = Rotate(Geometry=construct_point_2, Angle=degrees(number_slider_9), Plane=xy_plane)  # -> Geometry, Transform
number_slider_10 = Slider(123, range=0..500)
number_slider_11 = Slider(244, range=0..500)
number_slider_12 = Slider(254, range=0..500)
random = Random(Range=construct_domain, Number=list_length, Seed=Slider(1, range=0..1))
sphere = Sphere(Base=populate_3d, Radius=random)
number_slider_13 = Slider(2, range=0..3)
construct_point_5 = ConstructPoint(XCoordinate=number_slider_12, YCoordinate=number_slider_11, ZCoordinate=number_slider_10)
construct_point_6 = ConstructPoint(
    XCoordinate=expr("x+100", number_slider_12),
    YCoordinate=expr("x-100", number_slider_11),
    ZCoordinate=expr("x/2", number_slider_10))
construct_point_7 = ConstructPoint(
    XCoordinate=expr("500-x", number_slider_12),
    YCoordinate=expr("500-x", number_slider_11),
    ZCoordinate=expr("2*x", number_slider_10))
unit_z = UnitZ(Factor=Slider(82, range=0..300))
perp_frame = PerpFrame(Curve=reparameterize(extend_curve), Parameter=Slider(0, range=0..100))
construct_point_8 = ConstructPoint(
    XCoordinate=expr("300-x", number_slider_12),
    YCoordinate=expr("500-x", number_slider_11),
    ZCoordinate=expr("2*x", number_slider_10))
number_slider_14 = Slider(180, range=0..1000)  # disabled
length = Length(Curve=extend_curve)
amplitude = Amplitude(Vector=extend_curve, Amplitude=length)
sphere_2 = Sphere(Base=populate_3d, Radius=random)
solid_union = SolidUnion(Breps=sphere)
circle_cnr = CircleCNR(Center=construct_point_5, Normal=Vector(0, 0, 1), Radius=Slider(56, range=0..100))
xz = XZPlane(Origin=construct_point_4)  # disabled
circle = Circle(Plane=unit_z, Radius=Slider(776, range=0..1000))

# ----
# CLIPPING PLANE
# Link Clipping Plane
id = Guid(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)  # disabled

# ----
# ROTATE
number_slider_15 = Slider(100, range=0..100)
rotate_2 = Rotate(Geometry=xz, Angle=degrees(number_slider_14), Plane=construct_point_4)  # -> Geometry, Transform; disabled
# LIGHT
yz_plane = YZPlane(Origin=volume.Centroid)
merge = Merge(Data1=construct_point_5, Data2=construct_point_6, Data3=construct_point_7, Data4=construct_point_8)
rectangle = Rectangle(Plane=perp_frame, XSize=number_slider_13, YSize=number_slider_13, Radius=0)  # -> Rectangle, Length
c_script = CSharpScript(id=id, pl=rotate_2.Geometry)  # -> out; inputs id: Guid, pl: Plane; disabled
# ---------- c_script: C# ----------
    var cp = new Rhino.DocObjects.ObjRef(id);
    var source = cp.ClippingPlaneSurface().Plane;
    RhinoDoc.ActiveDoc.Objects.Transform(id, Transform.PlaneToPlane(source, pl), true);
# ---------- end c_script ----------
id_2 = Guid(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)
pt = Point(Point(15.9171654, 34.28599538, 0))
area_2 = Area(Geometry=sphere_2)  # -> Area, Centroid
split_brep = SplitBrep(Brep=solid_union, Cutter=circle)
rotate_3 = Rotate(Geometry=construct_point_2, Angle=expr("(x*-1)/2", degrees(number_slider_9)), Plane=yz_plane)  # -> Geometry, Transform
setlight = CSharpScript(run=Toggle(True), lightID=id_2, loc=rotate_3.Geometry, intensity=number_slider_15)  # -> out, A; inputs run: Boolean, lightID: Guid, loc: Point3d, intensity: Double
# ---------- setlight: C# ----------
    if(run){
      LightObject lo;
      if(lightID != System.Guid.Empty){
        lo = RhinoDocument.Objects.Find(lightID) as LightObject;
        if(lo == null) return;
      } else {
        return;
      }
      if(this.Component.Params.Input[2].VolatileDataCount > 0){
        lo.LightGeometry.Location = loc;
      }

      if(this.Component.Params.Input[3].VolatileDataCount > 0){
        lo.LightGeometry.Intensity = intensity / 100.0;
      }

      lo.CommitChanges();
    }
# ---------- end setlight ----------
extrude = Extrude(Base=rectangle.Rectangle, Direction=amplitude)
pull_point = PullPoint(Point=area.Centroid, Geometry=merge, ClosestOnly=True)  # -> ClosestPoint, Distance
list_item = ListItem(List=split_brep, Index=0, Wrap=True)
scale = Scale(Geometry=sphere_2, Center=area_2.Centroid, Factor=Slider(0.9, range=0..1))  # -> flatten(Geometry), Transform
# OUTPUT
cap_holes = CapHoles(Brep=extrude)
camera = VBScript(cam=construct_point_3, tar=construct_point_4)  # -> out; inputs cam: Point3d, tar: Point3d; disabled
# ---------- camera: C# ----------
    doc.Views.ActiveView.ActiveViewport.SetCameraLocations(tar, cam)
# ---------- end camera ----------
brep_2 = Brep(list_item)
populate_geometry = PopulateGeometry(Geometry=brep_2, Count=Slider(200, range=0..1000), Seed=1)
vector_2pt = Vector2Pt(PointA=pull_point.ClosestPoint, PointB=area.Centroid, Unitize=False)  # -> Vector, Length
deconstruct = Deconstruct(Point=area.Centroid)  # -> XComponent, YComponent, ZComponent
# OUTPUT
camera_2 = VBScript(cam=rotate.Geometry, tar=volume.Centroid)  # -> out; inputs cam: Point3d, tar: Point3d; same code as camera
voronoi_3d = Voronoi3D(Points=populate_geometry, Box=brep_2)  # -> Cells, Boundary
construct_point_9 = ConstructPoint(XCoordinate=deconstruct.XComponent, YCoordinate=deconstruct.YComponent, ZCoordinate=expr("x/5", vector_2pt.Length))
brep_3 = Brep(voronoi_3d.Cells)
solid_intersection = SolidIntersection(BrepsA=brep_3, BrepsB=brep_2)
circle_cnr_2 = CircleCNR(Center=construct_point_9, Normal=vector_2pt.Vector, Radius=Slider(7, range=0..20))
solid_difference = SolidDifference(BrepsA=solid_intersection, BrepsB=scale.Geometry)
custom_preview = CustomPreview(
    Geometry=circle_cnr_2,
    Material={diffuse=RGB(221, 160, 221), emission=RGB(66, 48, 66), shine=0.5, specular=RGB(255, 255, 255), transparency=0})
circle_cnr_3 = CircleCNR(Center=area.Centroid, Normal=Vector(0, 0, 1), Radius=Slider(6, range=0..20))
random_reduce = RandomReduce(List=solid_difference, Reduction=Slider(35, range=0..400), Seed=Slider(5, range=0..10))
graft_tree = GraftTree(Tree=circle_cnr_2, IncludeEmptyLists=True, IncludeNullItems=True)
graft_tree_2 = GraftTree(Tree=circle_cnr_3, IncludeEmptyLists=True, IncludeNullItems=True)
deconstruct_brep = DeconstructBrep(Brep=random_reduce)  # -> flatten(Faces), Edges, Vertices
loft = Loft(
    Curves=[graft_tree_2, graft_tree],
    Options={Adjust=False, Closed=False, LoftEnds=0, LoftSimp=0, LoftType=0, Rebuild=10, Refit=0.01})  # -> flatten(Loft)
pipe = Pipe(Curve=deconstruct_brep.Edges, Radius=Slider(2, range=0..4), Caps=Slider(2, range=0..10))  # -> flatten(Pipe)
custom_preview_2 = CustomPreview(Geometry=pipe, Material=ColourSwatch(SwatchColor=RGB(255, 255, 255)))

# ---- group: Interior
custom_preview_3 = CustomPreview(Geometry=brep, Material=ColourSwatch(SwatchColor=RGB(217, 176, 124)))
custom_preview_4 = CustomPreview(Geometry=cap_holes, Material=ColourSwatch(SwatchColor=RGB(255, 255, 255)))

# ----
number_slider_16 = Slider(32, range=0..200)

number_of_color = Slider(200, range=5..1000)
colour_wheel = ColourWheel(
    number_of_color,
    ColourGrips_Style=10,
    ColourGrips_Grip=[0.4552796035, 2.094395102, 4.188790205, 3.141592654],
    ColourGrips_Lum=[0.6068228696, 0.9402500735],
    ColourGrips_Range=[0.2762324003, 0.2762324003, 0.2762324003, 0.2762324003],
    ColourGrips_Sat=[0.9961830427, 0.9228996588])
list_length_2 = ListLength(List=loft)
repeat_data = RepeatData(Data=colour_wheel, Length=list_length_2)
jitter = Jitter(List=repeat_data, Jitter=1, Seed=number_slider_16)  # -> Values, Indices
preview_metal = PreviewMetal(Colour=jitter.Values, Reflection=Slider(0.7, range=0..1), Smoothness=Slider(0, range=0..1))  # -> Mat; inputs Colour: Color, Reflection: Double, Smoothness: Double
# ---------- preview_metal: C# usings ----------
using System.IO;
using System.Linq;
using System.Data;
using System.Drawing;
using System.Reflection;
using System.Windows.Forms;
using System.Xml;
using System.Xml.Linq;
using System.Runtime.InteropServices;

using Rhino.DocObjects;
using Rhino.Collections;
using GH_IO;
using GH_IO.Serialization;
# ---------- preview_metal: C# ----------
    Reflection = Math.Min(Math.Max(Reflection, 0), 1);
    Smoothness = Math.Min(Math.Max(Smoothness, 0), 1);

    Material material = new Material();
    material.ReflectionColor = Colour;
    material.DiffuseColor = Colour;
    material.AmbientColor = Color.Black;
    material.EmissionColor = Color.Black;
    material.Reflectivity = Reflection;
    material.ReflectionGlossiness = Smoothness;

    var renderMaterial = Rhino.Render.RenderMaterial.CreateBasicMaterial(material);
    Mat = new GH_Material(renderMaterial);
# ---------- end preview_metal ----------
custom_preview_5 = CustomPreview(Geometry=loft, Material=preview_metal)

number_of_color_2 = Slider(200, range=5..1000)
colour_wheel_2 = ColourWheel(
    number_of_color_2,
    ColourGrips_Style=10,
    ColourGrips_Grip=[0.4552796035, 2.094395102, 4.188790205, 3.141592654],
    ColourGrips_Lum=[0.6068228696, 0.9402500735],
    ColourGrips_Range=[0.2762324003, 0.2762324003, 0.2762324003, 0.2762324003],
    ColourGrips_Sat=[0.9961830427, 0.9228996588])
list_length_3 = ListLength(List=deconstruct_brep.Faces)
repeat_data_2 = RepeatData(Data=colour_wheel_2, Length=list_length_3)
jitter_2 = Jitter(List=repeat_data_2, Jitter=1, Seed=number_slider_16)  # -> Values, Indices
preview_metal_2 = PreviewMetal(Colour=jitter_2.Values, Reflection=Slider(0.7, range=0..1), Smoothness=Slider(0, range=0..1))  # -> Mat; inputs Colour: Color, Reflection: Double, Smoothness: Double; same code as preview_metal
custom_preview_6 = CustomPreview(Geometry=deconstruct_brep.Faces, Material=preview_metal_2)
