# Grasshopper definition puzzle.gh (Grasshopper 1.0.7)

number_slider = Slider(480, range=0..480)
number_slider_2 = Slider(0, range=0..480)
yz_plane = YZPlane(Origin=Point(0, 0, 0))
rectangle = Rectangle(Plane=yz_plane, XSize=number_slider, YSize=number_slider_2, Radius=0)  # -> Rectangle, Length
surface = Surface(rectangle.Rectangle)
divide_domain² = DivideDomain²(Domain=surface, UCount=number_slider, VCount=number_slider_2)
number_slider_3 = Slider(1, range=0..1)
isotrim = Isotrim(Surface=surface, Domain=divide_domain²)
rectangle_2 = Rectangle(Plane=PlaneXY(0, 0, 0), XSize=number_slider_3, YSize=number_slider_3, Radius=0)  # -> Rectangle, Length
jitter = Jitter(List=isotrim, Jitter=1, Seed=2)  # -> Values, Indices
deconstruct_brep = DeconstructBrep(Brep=isotrim)  # -> Faces, Edges, Vertices
deconstruct_brep_2 = DeconstructBrep(Brep=rectangle_2.Rectangle)  # -> Faces, Edges, Vertices
list_length = ListLength(List=jitter.Values)
unit_x = UnitX(Factor=Slider(0.15, range=0..1))
list_item = ListItem(List=deconstruct_brep_2.Vertices, Index=0, Wrap=True)  # -> Item, Item1, Item2, Item3
division = Division(A=list_length, B=Slider(3, range=0..10))
split_list = SplitList(List=jitter.Values, Index=division)  # -> ListA, ListB
xy_plane = XYPlane(Origin=Point(0, 0, 0))
line = Line(StartPoint=list_item.Item, EndPoint=list_item.Item2)
line_2 = Line(StartPoint=list_item.Item1, EndPoint=list_item.Item3)
extrude = Extrude(Base=deconstruct_brep.Faces, Direction=unit_x)
offset_surface = OffsetSurface(Surface=extrude, Distance=Slider(0.02, range=0..0.1), Retrim=Toggle(True))
orient = Orient(Geometry=line, Source=xy_plane, Target=split_list.ListA)  # -> Geometry, Transform
orient_2 = Orient(Geometry=line_2, Source=xy_plane, Target=split_list.ListB)  # -> Geometry, Transform
merge = Merge(Data1=orient.Geometry, Data2=orient_2.Geometry)
surface_split = SurfaceSplit(Surface=surface, Curves=merge)
random_reduce = RandomReduce(List=surface_split, Reduction=Slider(50, range=0..100), Seed=1)
construct_domain = ConstructDomain(DomainStart=Slider(0.1, range=0..0.1), DomainEnd=Slider(2, range=0..10))
list_length_2 = ListLength(List=random_reduce)
random = Random(Range=construct_domain, Number=list_length_2, Seed=2)
unit_x_2 = UnitX(Factor=random)
extrude_2 = Extrude(Base=random_reduce, Direction=unit_x_2)
